# Grasshopper definition DeductiveGeometry_001.gh (Grasshopper 1.0.7)
# plug-ins: ScriptParasite, Bifocals, Fologram For Grasshopper Utilities, Human

trigger = Trigger(Interval=100, TimerInterval=100, Target=data_recorder)  # disabled
data_recorder = DataRecorder("1", DataLimit=10000, RecordData=False)
list_length = ListLength(List=data_recorder)
panel = Panel(list_length)
division = Division(A=panel, B=Slider(50, range=1..1000))
cosine = Cosine(Value=division)
sine = Sine(Value=division)
panel_2 = Panel([cosine, sine])

addition = Addition(A=cosine, B=sine)
multiplication = Multiplication(A=cosine, B=sine)
here = CSharpScript()  # -> out, here
# ---------- here: C# usings ----------
using System.IO;
# ---------- here: C# ----------
    string currentFolder = "";

    GH_Document doc = owner.OnPingDocument();
    string filePath = doc.FilePath;
    string pathOnly = Path.GetDirectoryName(filePath);

    here = pathOnly;
# ---------- end here ----------
panel_3 = Panel(here.here)
number_slider = Slider(10, range=0..10)
number_slider_2 = Slider(0.664, range=0..1)
number_slider_3 = Slider(0.723, range=0..1)
absolute = Absolute(Value=cosine)
script_parasite = ScriptParasite(Enable=Toggle(False), Folder=here.here)
number_slider_4 = Slider(1, range=0..1)  # disabled
number_slider_5 = Slider(1, range=0..1)  # disabled
number_slider_6 = Slider(1, range=0..1)  # disabled
number_slider_7 = Slider(1, range=0..1)  # disabled
panel_4 = Panel("2")  # disabled
panel_5 = Panel("2")  # disabled
# Github Copilot Spiral Staircase
panel_8 = Panel("2")  # disabled
# Verticly Opposite  Angle Theorem
# Angle Sum Triangle Theorem
pi = Pi(Factor=panel_4)  # disabled
pi_2 = Pi(Factor=addition)  # disabled
pi_3 = Pi(Factor=cosine)  # disabled
# Angle Sum Triangle Theorem
# Three Corollaries
pi_4 = Pi(Factor=sine)  # disabled
pi_5 = Pi(Factor=panel_8)  # disabled
# Complementary Angle Theorem
# Supplementary Angle Theorem
number_slider_8 = Slider(10, range=0..10)  # disabled

number_slider_9 = Slider(8.257, range=0..10)  # disabled
number_slider_10 = Slider(6.552, range=0..10)  # disabled
number_slider_11 = Slider(5.96, range=0..10)  # disabled
number_slider_12 = Slider(0.452, range=0..1)  # disabled
deductivegeometry_001 = CSharpScript(x=number_slider_9, y=number_slider_10, z=number_slider_11, t=graft(number_slider_12))  # -> out, A, B, C, D; inputs x: Double, y: Double, z: Double, t: Double; disabled
# ---------- deductivegeometry_001: C# ----------
    //Algorithms
    //Euclidean Geometry, Similarity, Transformations
    //Deductive Geometry
    //write an algothim that demonstrates the CAT complementarity angle theorem 
    //create origin point
    Point3d origin = new Point3d(0, 0, 0);
    //create point at x,y,z
    Point3d point = new Point3d(x, y, 0);
    //create point at x,y,0
    Point3d point2 = new Point3d(0, 0, z);

    //create line from origin to point
    Line line = new Line(origin, point);
    //create line from origin to point2
    Line line2 = new Line(origin, point2);

    //create a line from point to point2
    Line line3 = new Line(point, point2);

    //find a point on line3 at the parameter value of t 
    Point3d point3 = line3.PointAt(t);

    //create a line from point to point3
    Line line4 = new Line(origin, point3);

    //calculate the angle between line and line4
    double angle = Vector3d.VectorAngle(line.Direction, line4.Direction);
    //convert angle to degrees
    double angleDeg = RhinoMath.ToDegrees(angle);
    //calculate the angle between line4 and line2
    double angle2 = Vector3d.VectorAngle(line4.Direction, line2.Direction);
    //convert angle to degrees
    double angleDeg2 = RhinoMath.ToDegrees(angle2);

    Print("The angle between line3 and line4 is " + angleDeg);
    Print("The angle between line3 and line2 is " + angleDeg2);

    if (angleDeg + angleDeg2 == 90)
    {
      Print("The angle add to 90 degrees");
    }
    else
    {
      Print("The angle do not add 90 degrees");
    }

    // Outputs
    A = line;
    B = line2;
    C = line3;
    D = line4;
# ---------- end deductivegeometry_001 ----------
line = Line(deductivegeometry_001.A)  # disabled
line_2 = Line(deductivegeometry_001.B)  # disabled
line_3 = Line(deductivegeometry_001.C)  # disabled
line_4 = Line(deductivegeometry_001.D)  # disabled
panel_9 = Panel(deductivegeometry_001.out)  # disabled
panel_10 = Panel(".1")  # disabled
panel_11 = Panel("2")  # disabled
pipe = Pipe(Curve=[line, line_2, line_3, line_4], Radius=panel_10, Caps=panel_11)  # disabled

number_slider_13 = Slider(10, range=0..10)  # disabled
multiplication_2 = Multiplication(A=absolute, B=pi)  # disabled
multiplication_3 = Multiplication(A=number_slider_4, B=pi_2)  # disabled
multiplication_4 = Multiplication(A=number_slider_5, B=pi_3)  # disabled
multiplication_5 = Multiplication(A=number_slider_6, B=pi_4)  # disabled
multiplication_6 = Multiplication(A=number_slider_7, B=pi_5)  # disabled
srf = Surface(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)
cat_001 = CSharpScript(x=number_slider, y=number_slider_8, z=number_slider_8, t=graft(absolute))  # -> out, A, B, C, D; inputs x: Double, y: Double, z: Double, t: Double; disabled; same code as deductivegeometry_001
astt_004 = CSharpScript(x=number_slider, u=multiplication_3, v=multiplication_4, w=multiplication_5)  # -> out, A, B, C, D; inputs x: Double, u: Double, v: Double, w: Double; disabled
# ---------- astt_004: C# ----------
    //Algorithms
    //Euclidean Geometry, Similarity, Transformations
    //Deductive Geometry
    //write an algothim that demonstrates the Angle Sum Triangle Theorem
    //create a XZ plane
    Plane plane = new Plane(new Point3d(0, 0, 0), new Vector3d(0, 0, 1));
    //create a circle on the plane
    Circle circle = new Circle(plane, x);

    //create three points on the circle at point u,v, and w
    Point3d pt1 = circle.PointAt(u);
    Point3d pt2 = circle.PointAt(v);
    Point3d pt3 = circle.PointAt(w);

    //create a line from pt1 to pt2
    Line line1 = new Line(pt1, pt2);
    //create a line from pt2 to pt3
    Line line2 = new Line(pt2, pt3);
    //create a line from pt3 to pt1
    Line line3 = new Line(pt3, pt1);

    // Outputs
    A = circle;
    B = line1;
    C = line2;
    D = line3;
# ---------- end astt_004 ----------
sat_002 = CSharpScript(x=number_slider, t=absolute)  # -> out, A, B, C, D, E; inputs x: Double, t: Double; disabled
# ---------- sat_002: C# ----------
    //Algorithms
    //Euclidean Geometry, Similarity, Transformations
    //Deductive Geometry
    //write an algothim that demonstrates the SAT Supplemantary Angle Theorem
    //create a XZ plane
    Plane plane = new Plane(new Point3d(0, 0, 0), new Vector3d(0, 1, 0));
    //create a circle on the plane
    Circle circle = new Circle(plane, x);

    //locate a point at the center of the circle
    Point3d center = circle.Center;
    //locate a point on the circle at 0 degrees
    Point3d point0 = circle.PointAt(0);
    //locate a point on the circle at 180 degrees
    Point3d point180 = circle.PointAt(Math.PI);
    //create a line from center to point0
    Line line0 = new Line(center, point0);
    //create a line from center to point180
    Line line180 = new Line(center, point180);

    //create a random point on the circle at point t
    Point3d pointT = circle.PointAt(t * Math.PI);
    //create a line from center to pointT
    Line lineT = new Line(center, pointT);
    //find angle between line0 and lineT
    double angle = Vector3d.VectorAngle(line0.Direction, lineT.Direction);
    //find angle between line180 and lineT
    double angle2 = Vector3d.VectorAngle(line180.Direction, lineT.Direction);
    //find the sum of the angles in degrees
    double sum = angle + angle2;



    // Outputs
    A = circle;
    B = line0;
    C = line180;
    D = sum;
    E = lineT;
# ---------- end sat_002 ----------
voat_003 = CSharpScript(x=number_slider, t=multiplication_2)  # -> out, A, B, C, D; inputs x: Double, t: Double; disabled
# ---------- voat_003: C# ----------
    //Algorithms
    //Euclidean Geometry, Similarity, Transformations
    //Deductive Geometry
    //write an algothim that demonstrates the VOAT Verticly Opposite Angles Theorem
    //create a XZ plane
    Plane plane = new Plane(new Point3d(0, 0, 0), new Vector3d(1, 0, 0));
    //create a circle on the plane
    Circle circle = new Circle(plane, x);

    //locate a point at the center of the circle
    Point3d center = circle.Center;
    //locate a point on the circle at 45 degrees
    Point3d point45 = circle.PointAt(Math.PI / 4);
    //locate a point on the circle at 225 degrees
    Point3d point225 = circle.PointAt(5 * Math.PI / 4);
    
    //create a line from center to point45
    Line line45 = new Line(center, point45);
    //create a line from center to point225
    Line line225 = new Line(center, point225);

    //create a random point on the circle at point t in radians
    Point3d randomPoint = circle.PointAt(t);
    //create a point on the circle at t + 180 degrees
    Point3d randomPoint180 = circle.PointAt(t + Math.PI);
    //create a line from randomPoint to randomPoint180
    Line randomLine = new Line(randomPoint, randomPoint180);



    // Outputs
    A = circle;
    B = line45;
    C = line225;
    D = randomLine;
# ---------- end voat_003 ----------
srf_2 = Surface(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)
astt_cor_005 = CSharpScript(x=number_slider_13, t=multiplication_6)  # -> out, A, B, C, D; inputs x: Double, t: Double; disabled
# ---------- astt_cor_005: C# ----------
    //Algorithms
    //Euclidean Geometry, Similarity, Transformations
    //Deductive Geometry
    //write an algothim that demonstrates the Angle Sum Triangle Theorem three corollaries
    //create a XZ plane
    Plane plane = new Plane(new Point3d(0, 0, 0), new Vector3d(0, 0, 1));
    //create a circle on the plane
    Circle circle = new Circle(plane, x);

    //create three points on the circle at point t, t/3, and 2*t/3
    Point3d pt1 = circle.PointAt(t);
    Point3d pt2 = circle.PointAt(t / 3);
    Point3d pt3 = circle.PointAt(2 * t / 3);

    //create a line from pt1 to pt2
    Line line1 = new Line(pt1, pt2);
    //create a line from pt2 to pt3
    Line line2 = new Line(pt2, pt3);
    //create a line from pt3 to pt1
    Line line3 = new Line(pt3, pt1);

    // Outputs
    A = circle;
    B = line1;
    C = line2;
    D = line3;
# ---------- end astt_cor_005 ----------
panel_12 = Panel(sat_002.D)  # disabled
line_5 = Line(cat_001.A)  # disabled
line_6 = Line(cat_001.B)  # disabled
line_7 = Line(cat_001.C)  # disabled
line_8 = Line(cat_001.D)  # disabled
circle = Circle(sat_002.A)  # disabled
line_9 = Line(sat_002.B)  # disabled
line_10 = Line(sat_002.C)  # disabled
line_11 = Line(sat_002.E)  # disabled
circle_2 = Circle(voat_003.A)  # disabled
line_12 = Line(voat_003.B)  # disabled
line_13 = Line(voat_003.C)  # disabled
line_14 = Line(voat_003.D)  # disabled
circle_3 = Circle(astt_004.A)  # disabled
line_15 = Line(astt_004.B)  # disabled
line_16 = Line(astt_004.C)  # disabled
line_17 = Line(astt_004.D)  # disabled
circle_4 = Circle(astt_cor_005.A)  # disabled
line_18 = Line(astt_cor_005.B)  # disabled
line_19 = Line(astt_cor_005.C)  # disabled
line_20 = Line(astt_cor_005.D)  # disabled
merge = Merge(Data1=line_5, Data2=line_6, Data3=line_7, Data4=line_8)  # disabled
merge_2 = Merge(Data1=circle, Data2=line_9, Data3=line_10, Data4=line_11)  # disabled
merge_3 = Merge(Data1=circle_2, Data2=line_12, Data3=line_13, Data4=line_14)  # disabled
merge_4 = Merge(Data1=circle_3, Data2=line_15, Data3=line_16, Data4=line_17)  # disabled
merge_5 = Merge(Data1=circle_4, Data2=line_18, Data3=line_19, Data4=line_20)  # disabled

spiralstaircase_bonus = CSharpScript(
    radius=Slider(24, range=3..24),
    height=Slider(0, range=0..10),
    turns=Slider(10, range=2..10),
    stepsPerTurn=Slider(9, range=3..10))  # -> out, A, B; inputs radius: Double, height: Double, turns: Int32, stepsPerTurn: Int32
# ---------- spiralstaircase_bonus: C# ----------
    //Algorithms
    //create a spiral staircase
    //check chatGPT for psuedocode
    // define the starting point and direction of the spiral
    Point3d startPoint = new Point3d(0, 0, 0);
    Vector3d startDirection = new Vector3d(1, 0, 0);

    // define the radius and height of each step
    //testing

    // define the number of turns and steps in the spiral


    // define the list of points and curves that will make up the staircase
    List<Point3d> points = new List<Point3d>();
    List<Curve> curves = new List<Curve>();

    // define the current position and direction of the spiral
    Point3d currentPos = startPoint;
    Vector3d currentDir = startDirection;

    // create the spiral staircase
    for (int i = 0; i < turns * stepsPerTurn; i++)
    {
      // add the current point to the list of points
      points.Add(currentPos);

      // create a line from the current point to the next point
      // in the spiral, and add it to the list of curves
      Point3d nextPos = currentPos + currentDir * height;
      curves.Add(new LineCurve(currentPos, nextPos));

      // update the current position and direction of the spiral
      currentPos = nextPos;
      currentDir.Rotate(Math.PI * 2 / stepsPerTurn, Vector3d.ZAxis);
    }

    // create a polyline from the points and add it to the document
    Polyline spiral = new Polyline(points);
    doc.Objects.AddPolyline(spiral);

    // create a surface from the curves and add it to the document
    Brep brep = Brep.CreateFromLoft(curves, Point3d.Unset, Point3d.Unset, LoftType.Normal, false)[0];
    doc.Objects.AddBrep(brep);

    //Output
    A = spiral;
    B = brep;
# ---------- end spiralstaircase_bonus ----------
geometry = Geometry(spiralstaircase_bonus.B)
geometry_2 = Geometry(spiralstaircase_bonus.A)

range = Range(Domain=number_slider_13, Steps=10)  # disabled
number_slider_14 = Slider(0.08, range=0..1)  # disabled
unit_z = UnitZ(Factor=range)  # disabled
multiplication_7 = Multiplication(A=range, B=sine)  # disabled
move = Move(Geometry=graft([line_18, line_19, line_20]), Motion=unit_z)  # -> Geometry, Transform; disabled
pi_6 = Pi(Factor=multiplication_7)  # disabled
join_curves = JoinCurves(Curves=move.Geometry, Preserve=False)  # disabled
rotate = Rotate(Geometry=join_curves, Angle=pi_6, Plane=PlaneXY(0, 0, 0))  # -> flatten(Geometry), Transform; disabled

merge_6 = Merge(Data1=merge, Data2=merge_2, Data3=merge_3, Data4=merge_4, Data5=merge_5, Data6=rotate.Geometry)  # disabled
number_slider_15 = Slider(12, range=0..12)  # disabled
panel_13 = Panel("pi * 0.1")  # disabled
mesh_pipe = MeshPipe(Polylines=merge_6, NumberOfSides=number_slider_15, Tolerance=0.1, Radius=panel_13, Cap=False, Join=False)  # disabled
boundary_surfaces = BoundarySurfaces(Edges=rotate.Geometry)  # disabled
button = Button()  # disabled
bake_geometry = BakeGeometry(Bake=button, Geometry=mesh_pipe, DeleteOldBakes=False, PreserveTrees=False)  # disabled
