# Grasshopper definition DeductiveGeometry_002.gh (Grasshopper 1.0.7)
# plug-ins: ScriptParasite, Bifocals, Fologram For Grasshopper Utilities, Human

trigger = Trigger(Interval=100, TimerInterval=100, Target=data_recorder)  # disabled
data_recorder = DataRecorder("1", DataLimit=10000, RecordData=False)
list_length = ListLength(List=data_recorder)
panel = Panel(list_length)
division = Division(A=panel, B=Slider(50, range=1..1000))
cosine = Cosine(Value=division)
sine = Sine(Value=division)
panel_2 = Panel([cosine, sine])

addition = Addition(A=cosine, B=sine)
multiplication = Multiplication(A=cosine, B=sine)
here = CSharpScript()  # -> out, here
# ---------- here: C# usings ----------
using System.IO;
# ---------- here: C# ----------
    string currentFolder = "";

    GH_Document doc = owner.OnPingDocument();
    string filePath = doc.FilePath;
    string pathOnly = Path.GetDirectoryName(filePath);

    here = pathOnly;
# ---------- end here ----------
panel_3 = Panel(here.here)
number_slider = Slider(0.723, range=0..1)
absolute = Absolute(Value=cosine)
script_parasite = ScriptParasite(Enable=Toggle(False), Folder=here.here)
# Complementary Angle Theorem
number_slider_2 = Slider(10, range=0..10)
srf = Surface(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)
eat_007 = CSharpScript(x=Slider(10, range=0..10), y=number_slider_2, z=number_slider_2, t=absolute)  # -> out, A, B, C, D; inputs x: Double, y: Double, z: Double, t: Double
# ---------- eat_007: C# ----------
    //Algorithms
    //Euclidean Geometry, Similarity, Transformations
    //Deductive Geometry
    //write an algothim that demonstrates the CAT complementarity angle theorem 
    //create origin point
    Point3d origin = new Point3d(0, 0, 0);
    //create point at x,y,z
    Point3d point = new Point3d(x, y, 0);
    //create point at x,y,0
    Point3d point2 = new Point3d(0, 0, z);

    //create line from origin to point
    Line line = new Line(origin, point);
    //create line from origin to point2
    Line line2 = new Line(origin, point2);

    //create a line from point to point2
    Line line3 = new Line(point, point2);

    //find a point on line3 at the parameter value of t 
    Point3d point3 = line3.PointAt(t);

    //create a line from point to point3
    Line line4 = new Line(origin, point3);

    //calculate the angle between line and line4
    double angle = Vector3d.VectorAngle(line.Direction, line4.Direction);
    //convert angle to degrees
    double angleDeg = RhinoMath.ToDegrees(angle);
    //calculate the angle between line4 and line2
    double angle2 = Vector3d.VectorAngle(line4.Direction, line2.Direction);
    //convert angle to degrees
    double angleDeg2 = RhinoMath.ToDegrees(angle2);

    Print("The angle between line3 and line4 is " + angleDeg);
    Print("The angle between line3 and line2 is " + angleDeg2);

    if (angleDeg + angleDeg2 == 90)
    {
      Print("The angle add to 90 degrees");
    }
    else
    {
      Print("The angle do not add 90 degrees");
    }

    // Outputs
    A = line;
    B = line2;
    C = line3;
    D = line4;
# ---------- end eat_007 ----------
srf_2 = Surface(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)
line = Line(eat_007.A)
line_2 = Line(eat_007.B)
line_3 = Line(eat_007.C)
line_4 = Line(eat_007.D)
merge = Merge(Data1=line, Data2=line_2, Data3=line_3, Data4=line_4)
merge_2 = Merge(Data1=merge)
mesh_pipe = MeshPipe(Polylines=merge_2, NumberOfSides=Slider(12, range=0..12), Tolerance=0.1, Radius="pi * 0.1", Cap=False, Join=False)
boundary_surfaces = BoundarySurfaces()
bake_geometry = BakeGeometry(Bake=Button(), Geometry=mesh_pipe, DeleteOldBakes=False, PreserveTrees=False)
