# Grasshopper definition CSharpParasite.gh (Grasshopper 1.0.7)
# plug-ins: ScriptParasite

f_01_loops = F_01_Loops(iterations=Slider(4, range=0..10))  # -> out; inputs iterations: Int32
# ---------- f_01_loops: C# usings ----------
using System.IO;
using System.Linq;
using System.Data;
using System.Drawing;
using System.Reflection;
using System.Windows.Forms;
using System.Xml;
using System.Xml.Linq;
using System.Runtime.InteropServices;

using Rhino.DocObjects;
using Rhino.Collections;
using GH_IO;
using GH_IO.Serialization;
# ---------- f_01_loops: C# ----------
    for(int i = 0; i < iterations; i++)
      Print(i.ToString());
# ---------- end f_01_loops ----------
script_parasite = ScriptParasite(Enable=Toggle(False), Folder="C:\Users\Sculpture\Desktop\dev")
panel = Panel(f_01_loops)
