# Grasshopper definition CSharpParasite_001.gh (Grasshopper 1.0.7)
# plug-ins: ScriptParasite

here = CSharpScript()  # -> out, here
# ---------- here: C# usings ----------
using System.IO;
# ---------- here: C# ----------
    string currentFolder = "";

    GH_Document doc = owner.OnPingDocument();
    string filePath = doc.FilePath;
    string pathOnly = Path.GetDirectoryName(filePath);

    here = pathOnly;
# ---------- end here ----------
panel = Panel(here.here)
panel_2 = Panel("C:\Users\Sculpture\Desktop\dev")

createpointintializexyz = CreatePointIntializeXYZ(x=Slider(0, range=0..10), y=Slider(10, range=0..10), z=Slider(10, range=0..10))  # -> out, Point, lineOut, movedLineOut, A, B, C; inputs x: Double, y: Double, z: Double
# ---------- createpointintializexyz: C# usings ----------
using System.IO;
using System.Linq;
using System.Data;
using System.Drawing;
using System.Reflection;
using System.Windows.Forms;
using System.Xml;
using System.Xml.Linq;
using System.Runtime.InteropServices;
using Rhino.DocObjects;
using Rhino.Collections;
using GH_IO;
using GH_IO.Serialization;
# ---------- createpointintializexyz: C# ----------
    //Create an instance of a point and initialize to x, y and z
    Point3d pt = new Point3d(x, y, z);
    //Create a line from the origin to the point
    Line line = new Line(Point3d.Origin, pt);
    //move the line 10 units in the x direction
    Line movedLine = new Line(line.From + new Vector3d(10, 0, 0), line.To + new Vector3d(10, 0, 0));
    //move the line 10 times in a range that uses trigonometry to create a list of 10 new lines
    List<Line> trigLines = new List<Line>();
    for (int i = 0; i < 10; i++)
    {
      double angle = i * 2 * Math.PI / 10;
      double xMove = Math.Cos(angle) * 10;
      double yMove = Math.Sin(angle) * 10;
      Line trigLine = new Line(line.From + new Vector3d(xMove, yMove, 0), line.To + new Vector3d(xMove, yMove, 0));
      trigLines.Add(trigLine);
    }
  
    //transform the list of lines with rotating transformations
    List<Line> trigLinesRotated = new List<Line>();
    for (int i = 0; i < 10; i++)
    {
      double angle = i * 2 * Math.PI / 10;
      Transform xform = Transform.Rotation(angle, Vector3d.ZAxis, Point3d.Origin);
      Line trigLineRotated = trigLines[i];
      trigLineRotated.Transform(xform);
      trigLinesRotated.Add(trigLineRotated);
    }
    //make a copy of the trigLinesRotated and mirror the trigLinesRotated on the xy plane
    List<Line> trigLinesRotatedMirrored = new List<Line>();
    for (int i = 0; i < 10; i++)
    {
      Line trigLineRotatedMirrored = trigLinesRotated[i];
      trigLineRotatedMirrored.Transform(Transform.Mirror(Plane.WorldXY));
      trigLinesRotatedMirrored.Add(trigLineRotatedMirrored);
    }
    //Orient trigLinesRotatedMirrored to a parametrically controlled rectangle grid on the yz plane
    List<Line> trigLinesRotatedMirroredOriented = new List<Line>();
    for (int i = 0; i < 10; i++)
    {
      double xMove = i * 10;
      double yMove = i * 10;
      Line trigLineRotatedMirroredOriented = trigLinesRotatedMirrored[i];
      trigLineRotatedMirroredOriented.Transform(Transform.Translation(xMove, yMove, 0));
      trigLinesRotatedMirroredOriented.Add(trigLineRotatedMirroredOriented);
    }
    

    //output
    Point = pt;
    lineOut = line;
    movedLineOut = trigLines;
    A = trigLinesRotated;
    B = trigLinesRotatedMirrored;
    C = trigLinesRotatedMirroredOriented;
# ---------- end createpointintializexyz ----------
script_parasite = ScriptParasite(Enable=Toggle(True), Folder=here.here)

line = Line(createpointintializexyz.B)
line_2 = Line(createpointintializexyz.movedLineOut)
line_3 = Line(createpointintializexyz.A)
line_4 = Line(createpointintializexyz.C)
point = Point(createpointintializexyz.Point)
line_5 = Line(createpointintializexyz.lineOut)
loft = Loft(Curves=line_4, Options={Adjust=False, Closed=False, LoftEnds=0, LoftSimp=0, LoftType=0, Rebuild=10, Refit=0.01})
panel_3 = Panel(point)
panel_4 = Panel(line_5)
loft_2 = Loft(Options={Adjust=False, Closed=False, LoftEnds=0, LoftSimp=0, LoftType=0, Rebuild=10, Refit=0.01})
panel_5 = Panel(line_3)
panel_6 = Panel(line_2)
