# Grasshopper definition CSharpParasite_002.gh (Grasshopper 1.0.7)
# plug-ins: ScriptParasite

gene_pool = GenePool(
    Decimals=3,
    Maximum=1,
    Minimum=-1,
    Value=[-0.3243963287, -0.4848631078, -0.1702514175, 0.8188209579, 0.5555596638, 0.3209702351])
explode_tree = ExplodeTree(Data=graft(gene_pool))  # -> Branch0, Branch1, Branch2, Branch3, Branch4, Branch5
trigger = Trigger(Interval=20, TimerInterval=20, Target=data_recorder)
data_recorder = DataRecorder("1", DataLimit=10000, RecordData=False)
list_length = ListLength(List=data_recorder)
panel = Panel(list_length)
division = Division(A=panel, B=Slider(51, range=21..100))
cosine = Cosine(Value=division)
sine = Sine(Value=division)
multiplication = Multiplication(A=sine, B=sine)
multiplication_2 = Multiplication(A=cosine, B=explode_tree.Branch0)
multiplication_3 = Multiplication(A=sine, B=explode_tree.Branch1)
multiplication_4 = Multiplication(B=cosine)
multiplication_5 = Multiplication(A=sine, B=sine)
multiplication_6 = Multiplication(A=cosine, B=cosine)
panel_2 = Panel(multiplication_2)
here = CSharpScript()  # -> out, here
# ---------- here: C# usings ----------
using System.IO;
# ---------- here: C# ----------
    string currentFolder = "";

    GH_Document doc = owner.OnPingDocument();
    string filePath = doc.FilePath;
    string pathOnly = Path.GetDirectoryName(filePath);

    here = pathOnly;
# ---------- end here ----------
panel_3 = Panel(here.here)
panel_4 = Panel("C:\Users\Sculpture\Desktop\dev")

createpolygon_002 = CreatePointIntializeXYZ(xa=panel_2, ya=multiplication_3, xb=multiplication_4, yb=multiplication_5, xc=multiplication_6, yc=multiplication)  # -> out, polylineOut, midPtsOut, A, B, C, D, E; inputs xa: Double, ya: Double, xb: Double, yb: Double, xc: Double, yc: Double
# ---------- createpolygon_002: C# usings ----------
using System.IO;
using System.Linq;
using System.Data;
using System.Drawing;
using System.Reflection;
using System.Windows.Forms;
using System.Xml;
using System.Xml.Linq;
using System.Runtime.InteropServices;
using Rhino.DocObjects;
using Rhino.Collections;
using GH_IO;
using GH_IO.Serialization;
# ---------- createpolygon_002: C# ----------
    //create a pentagon centered on the origin with a radius of 1
    Point3d[] pts = new Point3d[5];
    pts[0] = new Point3d(xa, ya, 0);
    pts[1] = new Point3d(xb, yb, 0);
    pts[2] = new Point3d(xc, -yc, 0);
    pts[3] = new Point3d(-xc, -yc, 0);
    pts[4] = new Point3d(-xb, yc, 0);

    //create a polygon
    Polyline pl = new Polyline(pts);
    pl.Add(pts[0]);

    //find the midpoint of the polyline segments
    List<Point3d> midPts = new List<Point3d>();
    for (int i = 0; i < pl.Count - 1; i++)
    {
      Point3d midPt = pl[i] + (pl[i + 1] - pl[i]) / 2;
      midPts.Add(midPt);
    }
    //find the center of the points
    Point3d centroid = Point3d.Origin;
    
    //move the midPts halfway to the centroid
    for (int i = 0; i < midPts.Count; i++)
    {
      midPts[i] = midPts[i] + (centroid - midPts[i]) / 2;
    }
    //move the midPts up by 1
    for (int i = 0; i < midPts.Count; i++)
    {
      midPts[i] = midPts[i] + new Vector3d(0, 0, 1);
    }
    //create a list of line that connect the midPts to the original points
    List<Line> lines = new List<Line>();
    for (int i = 0; i < midPts.Count; i++)
    {
      Line l = new Line(midPts[i], pl[i]);
      lines.Add(l);
    }
    //create a list of points that are the intersection of the lines

    //Outputs
    polylineOut = pl;
    midPtsOut = midPts;
    A = lines[0];
    B = lines[1];
    C = lines[2];
    D = lines[3];
    E = lines[4];
# ---------- end createpolygon_002 ----------
script_parasite = ScriptParasite(Enable=Toggle(False), Folder=here.here)

point = Point(createpolygon_002.midPtsOut)
curve = Curve(createpolygon_002.A)
curve_2 = Curve(createpolygon_002.B)
curve_3 = Curve(createpolygon_002.C)
curve_4 = Curve(createpolygon_002.polylineOut)
curve_5 = Curve(createpolygon_002.D)
curve_6 = Curve(createpolygon_002.E)
panel_5 = Panel(createpolygon_002.out)
merge = Merge(Data2=curve, Data3=curve_2, Data4=curve_3, Data5=curve_5, Data6=curve_6)
pipe = Pipe(Curve=merge, Radius=Slider(0.072, range=0..1), Caps="2")
