# Grasshopper definition CSharpParasite_004.gh (Grasshopper 1.0.7)
# plug-ins: ScriptParasite

gene_pool = GenePool(Decimals=3, Maximum=1, Minimum=-1, Value=[1, -1, 1, -1, 1, -1])
explode_tree = ExplodeTree(Data=graft(gene_pool))  # -> Branch0, Branch1, Branch2, Branch3, Branch4, Branch5
trigger = Trigger(Interval=20, TimerInterval=20, Target=data_recorder)
data_recorder = DataRecorder("1", DataLimit=10000, RecordData=True)
list_length = ListLength(List=data_recorder)
number_slider = Slider(10, range=1..10)
panel = Panel(list_length)
division = Division(A=panel, B=Slider(21, range=21..100))
cosine = Cosine(Value=division)
sine = Sine(Value=division)
construct_domain = ConstructDomain(DomainStart=expr("x*1.1", sine), DomainEnd=cosine)
construct_domain_2 = ConstructDomain(DomainStart=expr("x*1.1", cosine), DomainEnd=sine)
panel_2 = Panel("C:\Users\Sculpture\Desktop\dev")
multiplication = Multiplication(A=sine, B=sine)
multiplication_2 = Multiplication(A=cosine, B=explode_tree.Branch0)
multiplication_3 = Multiplication(A=multiplication_2, B=Slider(1.976, range=0..10))
construct_point = ConstructPoint(XCoordinate=multiplication_3, YCoordinate=0, ZCoordinate=0)
multiplication_4 = Multiplication(A=sine, B=explode_tree.Branch1)
multiplication_5 = Multiplication(B=cosine)
multiplication_6 = Multiplication(A=sine, B=sine)
multiplication_7 = Multiplication(A=cosine, B=cosine)
range = Range(Domain=construct_domain, Steps=number_slider)
here = CSharpScript()  # -> out, here
# ---------- here: C# usings ----------
using System.IO;
# ---------- here: C# ----------
    string currentFolder = "";

    GH_Document doc = owner.OnPingDocument();
    string filePath = doc.FilePath;
    string pathOnly = Path.GetDirectoryName(filePath);

    here = pathOnly;
# ---------- end here ----------
range_2 = Range(Domain=construct_domain_2, Steps=number_slider)
quad_sphere = QuadSphere(Base=construct_point, Radius=Slider(2, range=0..10))
number_slider_2 = Slider(10, range=0..10)
number_slider_3 = Slider(10, range=0..10)
panel_3 = Panel(here.here)
deconstruct_brep = DeconstructBrep(Brep=quad_sphere)  # -> Faces, Edges, Vertices
panel_4 = Panel(range_2)
construct_point_2 = ConstructPoint(XCoordinate=range_2, YCoordinate=range, ZCoordinate=0)
surface = Surface(deconstruct_brep.Faces)
evaluate_surface = EvaluateSurface(Surface=reparameterize(flatten(surface)), Point=construct_point_2)  # -> Point, Normal, UDirection, VDirection, Frame
divide_surface = DivideSurface(Surface=surface, UCount=number_slider_3, VCount=number_slider_2)  # -> Points, Normals, Parameters

createpointgeometry_003 = CSharpScript(S=surface, U=number_slider_3, V=number_slider_2)  # -> out, P, N, M, G, uv; inputs S: Surface, U: Int32, V: Int32
# ---------- createpointgeometry_003: C# ----------
    //Algorithms
  
    // Get domains
    Interval uDomain = S.Domain(0);
    double uStep = uDomain.Length / U;
    Interval vDomain = S.Domain(1);
    double vStep = vDomain.Length / V;

    // Generate output information coordinates
    List<Point3d> pts = new List<Point3d>();
    List<Vector3d> normals = new List<Vector3d>();
    List<Point2d> uvPts = new List<Point2d>();
    List<double> means = new List<double>();
    List<double> gaussians = new List<double>();
    for (int i = 0; i < U + 1; i++)
    {
      double u = uDomain.T0 + i * uStep;
      for (int j = 0; j < V + 1; j++)
      {
        double v = vDomain.T0 + j * vStep;

        // Get surface curvature values
        SurfaceCurvature sc = S.CurvatureAt(u, v);

        // Extract info from the SC object
        pts.Add(sc.Point);
        normals.Add(sc.Normal);
        uvPts.Add(sc.UVPoint);
        means.Add(sc.Mean);
        gaussians.Add(sc.Gaussian);
      }
    }

    // Outputs
    P = pts;
    N = normals;
    M = means;
    G = gaussians;
    uv = uvPts;
# ---------- end createpointgeometry_003 ----------
script_parasite = ScriptParasite(Enable=Toggle(False), Folder=here.here)

srf = Surface(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)
point = Point(createpointgeometry_003.P)
vector = Vector(createpointgeometry_003.N)
number = Number(createpointgeometry_003.M)
point_2 = Point(createpointgeometry_003.uv)
number_2 = Number(createpointgeometry_003.G)
srf_2 = Surface(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)
panel_5 = Panel(createpointgeometry_003.out)
point_3 = Point([evaluate_surface.UDirection, evaluate_surface.VDirection])
vector_display = VectorDisplay(Anchor=point, Vector=evaluate_surface.Normal)
move = Move(Geometry=evaluate_surface.Point, Motion=point_3)  # -> Geometry, Transform
panel_6 = Panel(point_2)
interpolate = Interpolate(Vertices=move.Geometry, Degree=3, Periodic=False, KnotStyle=1)  # -> Curve, Length, Domain
orient = Orient(Geometry=interpolate.Curve, Source=point_3, Target=flatten(evaluate_surface.Point))  # -> Geometry, Transform
list_length_2 = ListLength(List=orient.Geometry)
number_slider_4 = Slider(4, range=0..10)
divide_curve = DivideCurve(Curve=orient.Geometry, Count=graft(list_length_2), Kinks=False)  # -> Points, Tangents, Parameters
mesh_sphere = MeshSphere(Base=divide_curve.Points, Radius=Slider(0.66, range=0..1), UCount=number_slider_4, VCount=number_slider_4)
absolute = Absolute(Value=multiplication_2)
mesh_join = MeshJoin(Meshes=flatten(mesh_sphere))
gradient = Gradient(
    LowerLimit=Slider(0.19, range=0..1),
    UpperLimit=Slider(0.803, range=0..1),
    Parameter=absolute,
    stops=[0.163: RGB(254, 244, 84), 0.881: RGB(173, 203, 249), 1: RGB(75, 107, 169)])
panel_7 = Panel(absolute)
deconstruct_mesh = DeconstructMesh(Mesh=mesh_join)  # -> Vertices, Faces, Colours, Normals
construct_mesh = ConstructMesh(Vertices=deconstruct_mesh.Vertices, Faces=deconstruct_mesh.Faces, Colours=gradient)
