# Grasshopper definition CSharpParasite_005.gh (Grasshopper 1.0.7)
# plug-ins: ScriptParasite, Fologram For Grasshopper Utilities, Kangaroo2 Components, Human

trigger = Trigger(Interval=100, TimerInterval=100, Target=data_recorder)  # disabled
data_recorder = DataRecorder("1", DataLimit=10000, RecordData=False)
list_length = ListLength(List=data_recorder)
panel = Panel(list_length)
gene_pool = GenePool(
    Decimals=3,
    Maximum=1,
    Minimum=-1,
    Value=[-0.6944764348, -0.64008129, 0.9004190489, 0.01469261805, 0.9234823389, 0.8279040651])
division = Division(A=panel, B=Slider(50, range=1..1000))
cosine = Cosine(Value=division)
sine = Sine(Value=division)
explode_tree = ExplodeTree(Data=graft(gene_pool))  # -> Branch0, Branch1, Branch2, Branch3, Branch4, Branch5
number_slider = Slider(10, range=1..10)
multiplication = Multiplication(A=sine, B=sine)
multiplication_2 = Multiplication(A=cosine, B=explode_tree.Branch0)
multiplication_3 = Multiplication(A=sine, B=explode_tree.Branch1)
multiplication_4 = Multiplication(B=cosine)
multiplication_5 = Multiplication(A=sine, B=sine)
multiplication_6 = Multiplication(A=cosine, B=cosine)
multiplication_7 = Multiplication(A=multiplication_2, B=Slider(8.813, range=0..100))
construct_domain = ConstructDomain(DomainStart=expr("x*1.1", sine), DomainEnd=cosine)
construct_domain_2 = ConstructDomain(DomainStart=expr("x*1.1", cosine), DomainEnd=sine)
construct_point = ConstructPoint(XCoordinate=multiplication_7, YCoordinate=multiplication_7, ZCoordinate=multiplication_7)
here = CSharpScript()  # -> out, here
# ---------- here: C# usings ----------
using System.IO;
# ---------- here: C# ----------
    string currentFolder = "";

    GH_Document doc = owner.OnPingDocument();
    string filePath = doc.FilePath;
    string pathOnly = Path.GetDirectoryName(filePath);

    here = pathOnly;
# ---------- end here ----------
quad_sphere = QuadSphere(Base=construct_point, Radius=Slider(23, range=0..100))
panel_2 = Panel("2")
number_slider_2 = Slider(6, range=0..10)
panel_3 = Panel(here.here)
deconstruct_brep = DeconstructBrep(Brep=quad_sphere)  # -> Faces, Edges, Vertices
list_length_2 = ListLength(List=deconstruct_brep.Faces)
range = Range(Domain=construct_domain, Steps=expr("x-1", list_length_2))
range_2 = Range(Domain=construct_domain_2, Steps=expr("x-1", list_length_2))
absolute = Absolute(Value=range_2)
absolute_2 = Absolute(Value=range)
addition = Addition(A=absolute_2, B=Slider(0.02, range=0.01..0.1))
number_slider_3 = Slider(0.53, range=0..10)
panel_4 = Panel("C:\Users\Sculpture\Desktop\dev")
division_2 = Division(A=absolute, B=addition)

script_parasite = ScriptParasite(Enable=Toggle(True), Folder=here.here)
createpointgeometry_005 = CSharpScript(S=deconstruct_brep.Faces, U=number_slider_2, V=number_slider_2, r=range_2)  # -> out, A, vecOut, randOut, vecOut3, B; inputs S: Surface, U: Int32, V: Int32, r: Double
# ---------- createpointgeometry_005: C# ----------
    //Algorithms
    //create a list of points
    List<Point3d> pts = new List<Point3d>();
    //populate the list with points
    for (int i = 0; i < U; i++)
    {
      for (int j = 0; j < V; j++)
      {
        //create a point
        Point3d pt = S.PointAt((double) i / (U - 1), (double) j / (V - 1));
        //add the point to the list
        pts.Add(pt);
      }
    }
    //create a vector from the origin(x,y,z) to each of the points
    List<Vector3d> vector = new List<Vector3d>();
    for (int i = 0; i < pts.Count; i++)
    {
      Vector3d vec = new Vector3d(pts[i]);
      vector.Add(vec);
    }
    //applify the vector by a random number
    for (int i = 0; i < vector.Count; i++)
    {
      //create a random number generator
      Random rand2 = new Random();
      //create a random number
      //double r = rand2.NextDouble();
      //multiply the vector by the random number
      vector[i] = vector[i] * r;
    }

    //create a random walker algorithm that create 1000 points
    //create a list of points
    List<Point3d> pts2 = new List<Point3d>();
    //create a random number generator
    Random rand = new Random();
    //create a point
    Point3d pt2 = new Point3d(0, 0, 0);
    //add the point to the list
    pts2.Add(pt2);
    //create a loop that will create 1000 points
    for (int i = 0; i < 100; i++)
    {
      //create a random number
      int r1 = rand.Next(0, vector.Count);
      //create a vector
      Vector3d vec2 = vector[r1];
      //create a point
      Point3d pt3 = new Point3d(pt2 + vec2);
      //add the point to the list
      pts2.Add(pt3);
      //update the point
      pt2 = pt3;
    }

    //orient the points to the pts2 list
    //create a list of vectors
    List<Vector3d> vec3 = new List<Vector3d>();
    //create a loop that will create a vector from each point to the next point
    for (int i = 0; i < pts.Count; i++)
    {
      //create a vector
      Vector3d vec4 = new Vector3d(pts[i]);
      //add the vector to the list
      vec3.Add(vec4);
    }
    //create a loop that will orient the points
    for (int i = 0; i < pts.Count; i++)
    {
      //create a point
      Point3d pt4 = new Point3d(pts[i] + vec3[i]);
      //add the point to the list
      pts[i] = pt4;
    }


    // Outputs
    A = pts;
    vecOut = vector;
    randOut = pts2;
    vecOut3 = vec3;
    B = pts2;
# ---------- end createpointgeometry_005 ----------

srf = Surface(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)
point = Point(createpointgeometry_005.A)
vector = Vector(createpointgeometry_005.vecOut)
point_2 = Point(createpointgeometry_005.randOut)
vector_2 = Vector(createpointgeometry_005.vecOut3)
point_3 = Point(createpointgeometry_005.B)
srf_2 = Surface(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)
panel_5 = Panel(createpointgeometry_005.out)
number_slider_4 = Slider(2, range=0..10)  # disabled
vector_display = VectorDisplay(Anchor=point, Vector=vector)
vector_display_2 = VectorDisplay(Anchor=point, Vector=vector_2)
interpolate = Interpolate(Vertices=point_3, Degree=3, Periodic=False, KnotStyle=1)  # -> Curve, Length, Domain
mesh_pipe = MeshPipe(Polylines=interpolate.Curve, NumberOfSides=4, Tolerance=0.1, Radius=division_2, Cap=False, Join=False)
multipipe = MultiPipe(
    Curves=interpolate.Curve,
    NodeSize=number_slider_4,
    EndOffset=1,
    StrutSize=1,
    Segment=0,
    KinkAngle=0.6,
    CubeFit=0,
    Caps=0)  # disabled
bake_geometry = BakeGeometry(Bake=Toggle(False), Geometry=mesh_pipe, DeleteOldBakes=False, PreserveTrees=False)
