# Grasshopper definition CSharpParasite_006.gh (Grasshopper 1.0.7)
# plug-ins: ScriptParasite, Fologram For Grasshopper Utilities, Kangaroo2 Components, Human, Bifocals

trigger = Trigger(Interval=100, TimerInterval=100, Target=data_recorder)  # disabled
data_recorder = DataRecorder("1", DataLimit=10000, RecordData=True)
list_length = ListLength(List=data_recorder)
panel = Panel(list_length)
gene_pool = GenePool(
    Decimals=3,
    Maximum=1,
    Minimum=-1,
    Value=[-0.8613705271, -0.6443256399, 0.3545180007, -0.9764927085, -0.8314990307, 0.5318568282])
division = Division(A=panel, B=Slider(50, range=1..1000))
cosine = Cosine(Value=division)
sine = Sine(Value=division)
explode_tree = ExplodeTree(Data=graft(gene_pool))  # -> Branch0, Branch1, Branch2, Branch3, Branch4, Branch5
number_slider = Slider(10, range=1..10)
multiplication = Multiplication(A=sine, B=sine)
multiplication_2 = Multiplication(A=cosine, B=explode_tree.Branch0)
multiplication_3 = Multiplication(A=sine, B=explode_tree.Branch1)
multiplication_4 = Multiplication(B=cosine)
multiplication_5 = Multiplication(A=sine, B=sine)
multiplication_6 = Multiplication(A=cosine, B=cosine)
multiplication_7 = Multiplication(A=multiplication_2, B=Slider(8.813, range=0..100))
construct_domain = ConstructDomain(DomainStart=expr("x*1.1", sine), DomainEnd=cosine)
construct_domain_2 = ConstructDomain(DomainStart=expr("x*1.1", cosine), DomainEnd=sine)
construct_point = ConstructPoint(XCoordinate=multiplication_7, YCoordinate=multiplication_7, ZCoordinate=multiplication_7)
here = CSharpScript()  # -> out, here
# ---------- here: C# usings ----------
using System.IO;
# ---------- here: C# ----------
    string currentFolder = "";

    GH_Document doc = owner.OnPingDocument();
    string filePath = doc.FilePath;
    string pathOnly = Path.GetDirectoryName(filePath);

    here = pathOnly;
# ---------- end here ----------
quad_sphere = QuadSphere(Base=construct_point, Radius=Slider(23, range=0..100))
panel_2 = Panel("2")
panel_3 = Panel("C:\Users\Sculpture\Desktop\dev")
deconstruct_brep = DeconstructBrep(Brep=quad_sphere)  # -> Faces, Edges, Vertices
list_length_2 = ListLength(List=deconstruct_brep.Faces)
range = Range(Domain=construct_domain, Steps=expr("x-1", list_length_2))
range_2 = Range(Domain=construct_domain_2, Steps=expr("x-1", list_length_2))
absolute = Absolute(Value=range_2)
absolute_2 = Absolute(Value=range)
addition = Addition(A=absolute_2, B=Slider(0.02, range=0.01..0.1))
division_2 = Division(A=absolute, B=addition)
panel_4 = Panel(here.here)
srf = Surface(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)
srf_2 = Surface(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)

createpointgeometry_006 = CSharpScript(
    xCount=Slider(10, range=0..10),
    yCount=Slider(7, range=0..10),
    baseRadius=Slider(0.248, range=0.1..0.3),
    zExtrude=Slider(3.22, range=0..10))  # -> out, A, B, C, D, E; inputs xCount: Int32, yCount: Int32, baseRadius: Double, zExtrude: Double
# ---------- createpointgeometry_006: C# ----------
    //Algorithms
    //create a point grid in rhino common that maps out a surface floor plan for the acropolis
    //create a list of points
    List<Point3d> pts = new List<Point3d>();
    //populate the list with points
    for (int i = 0; i < xCount; i++)
    {
      for (int j = 0; j < yCount; j++)
      {
        pts.Add(new Point3d(i, j, 0));
      }
    }
    
    //select the points that are best used for the outer contour of the acropolis and create circles at those points
    //create a list of points
    List<Point3d> pts2 = new List<Point3d>();
    //populate the list with points that are on the outer contour of the acropolis
    for (int i = 0; i < xCount; i++)
    {
      for (int j = 0; j < yCount; j++)
      {
        if (i == 0 || i == xCount - 1 || j == 0 || j == yCount -1)
        {
          pts2.Add(new Point3d(i, j, 0));
        }
      }
    }
    //create a list of circles
    List<Circle> circles = new List<Circle>();
    //populate the list with circles at the points that are on the outer contour of the acropolis
    for (int i = 0; i < pts2.Count; i++)
    {
      circles.Add(new Circle(pts2[i], baseRadius));
    }
    //create a list of curves
    List<Curve> curves = new List<Curve>();
    //populate the list with curves that are the circles
    for (int i = 0; i < circles.Count; i++)
    {
      curves.Add(circles[i].ToNurbsCurve());
    }
    //create a list of surfaces using rhino common api
    List<Surface> surfaces = new List<Surface>();
    //populate the list with surfaces that are the extrusions of the curves
    for (int i = 0; i < curves.Count; i++)
    {
      surfaces.Add(Surface.CreateExtrusion(curves[i], new Vector3d(0, 0, zExtrude)));
    }
    
    // Outputs
    A = pts;
    B = pts2;
    C = circles;
    D = curves;
    E = surfaces;
# ---------- end createpointgeometry_006 ----------
script_parasite = ScriptParasite(Enable=Toggle(False), Folder=here.here)

curve = Curve(createpointgeometry_006.D)
point = Point(createpointgeometry_006.A)
point_2 = Point(createpointgeometry_006.B)
circle = Circle(createpointgeometry_006.C)
surface = Surface(createpointgeometry_006.E)
point_3 = Point()
vector = Vector()
point_4 = Point()
vector_2 = Vector()
point_5 = Point()
panel_5 = Panel(createpointgeometry_006.out)
number_slider_2 = Slider(2, range=0..10)  # disabled
vector_display = VectorDisplay(Anchor=point_3, Vector=vector)
vector_display_2 = VectorDisplay(Anchor=point_3, Vector=vector_2)
interpolate = Interpolate(Vertices=point_5, Degree=3, Periodic=False, KnotStyle=1)  # -> Curve, Length, Domain
mesh_pipe = MeshPipe(Polylines=interpolate.Curve, NumberOfSides=4, Tolerance=0.1, Radius=division_2, Cap=False, Join=False)
multipipe = MultiPipe(
    Curves=interpolate.Curve,
    NodeSize=number_slider_2,
    EndOffset=1,
    StrutSize=1,
    Segment=0,
    KinkAngle=0.6,
    CubeFit=0,
    Caps=0)  # disabled
bake_geometry = BakeGeometry(Bake=Toggle(False), Geometry=mesh_pipe, DeleteOldBakes=False, PreserveTrees=False)
