# Grasshopper definition CSharpParasite_BoilerPlate_001.gh (Grasshopper 1.0.7)
# plug-ins: ScriptParasite

gene_pool = GenePool(
    Decimals=3,
    Maximum=1,
    Minimum=-1,
    Value=[-0.3243963287, -0.4848631078, -0.1702514175, 0.8188209579, 0.5555596638, 0.3209702351])
explode_tree = ExplodeTree(Data=graft(gene_pool))  # -> Branch0, Branch1, Branch2, Branch3, Branch4, Branch5
trigger = Trigger(Interval=20, TimerInterval=20, Target=data_recorder)
data_recorder = DataRecorder("1", DataLimit=10000, RecordData=False)
list_length = ListLength(List=data_recorder)
panel = Panel(list_length)
division = Division(A=panel, B=Slider(51, range=21..100))
cosine = Cosine(Value=division)
sine = Sine(Value=division)
multiplication = Multiplication(A=sine, B=sine)
multiplication_2 = Multiplication(A=cosine, B=explode_tree.Branch0)
multiplication_3 = Multiplication(A=sine, B=explode_tree.Branch1)
multiplication_4 = Multiplication(B=cosine)
multiplication_5 = Multiplication(A=sine, B=sine)
multiplication_6 = Multiplication(A=cosine, B=cosine)
panel_2 = Panel(multiplication_2)
panel_3 = Panel("C:\Users\Sculpture\Desktop\dev")
here = CSharpScript()  # -> out, here
# ---------- here: C# usings ----------
using System.IO;
# ---------- here: C# ----------
    string currentFolder = "";

    GH_Document doc = owner.OnPingDocument();
    string filePath = doc.FilePath;
    string pathOnly = Path.GetDirectoryName(filePath);

    here = pathOnly;
# ---------- end here ----------
panel_4 = Panel(here.here)

script_parasite = ScriptParasite(Enable=Toggle(False), Folder=here.here)
createpointgeometry_003 = CreatePointIntializeXYZ()  # -> out
# ---------- createpointgeometry_003: C# usings ----------
using System.IO;
using System.Linq;
using System.Data;
using System.Drawing;
using System.Reflection;
using System.Windows.Forms;
using System.Xml;
using System.Xml.Linq;
using System.Runtime.InteropServices;
using Rhino.DocObjects;
using Rhino.Collections;
using GH_IO;
using GH_IO.Serialization;
# ---------- createpointgeometry_003: C# ----------
    //Algorithm

    //Outputs
# ---------- end createpointgeometry_003 ----------

panel_5 = Panel(createpointgeometry_003)
