# Grasshopper definition DeductiveGeometry_001.gh (Grasshopper 1.0.7)
# plug-ins: ScriptParasite, Bifocals

trigger = Trigger(Interval=100, TimerInterval=100, Target=data_recorder)
data_recorder = DataRecorder("1", DataLimit=10000, RecordData=True)
list_length = ListLength(List=data_recorder)
panel = Panel(list_length)
gene_pool = GenePool(Decimals=3, Maximum=1, Minimum=-1, Value=[1, 0.1704196665, -0.1093132799, -0.6988400313, -0.6547908744, 0.6909152249])
division = Division(A=panel, B=Slider(50, range=1..1000))
cosine = Cosine(Value=division)
sine = Sine(Value=division)
explode_tree = ExplodeTree(Data=graft(gene_pool))  # -> Branch0, Branch1, Branch2, Branch3, Branch4, Branch5
number_slider = Slider(10, range=1..10)
multiplication = Multiplication(A=sine, B=sine)
multiplication_2 = Multiplication(A=cosine, B=explode_tree.Branch0)
multiplication_3 = Multiplication(A=sine, B=explode_tree.Branch1)
multiplication_4 = Multiplication(B=cosine)
multiplication_5 = Multiplication(A=sine, B=sine)
multiplication_6 = Multiplication(A=cosine, B=cosine)
multiplication_7 = Multiplication(A=multiplication_2, B=Slider(12.013, range=0..100))
construct_domain = ConstructDomain(DomainStart=expr("x*1.1", sine), DomainEnd=cosine)
construct_domain_2 = ConstructDomain(DomainStart=expr("x*1.1", cosine), DomainEnd=sine)
construct_point = ConstructPoint(XCoordinate=multiplication_7, YCoordinate=multiplication_7, ZCoordinate=multiplication_7)
here = CSharpScript()  # -> out, here
# ---------- here: C# usings ----------
using System.IO;
# ---------- here: C# ----------
    string currentFolder = "";

    GH_Document doc = owner.OnPingDocument();
    string filePath = doc.FilePath;
    string pathOnly = Path.GetDirectoryName(filePath);

    here = pathOnly;
# ---------- end here ----------
quad_sphere = QuadSphere(Base=construct_point, Radius=Slider(23, range=0..100))
panel_2 = Panel("2")
panel_3 = Panel("C:\Users\Sculpture\Desktop\dev")
deconstruct_brep = DeconstructBrep(Brep=quad_sphere)  # -> Faces, Edges, Vertices
list_length_2 = ListLength(List=deconstruct_brep.Faces)
range = Range(Domain=construct_domain, Steps=expr("x-1", list_length_2))
range_2 = Range(Domain=construct_domain_2, Steps=expr("x-1", list_length_2))
absolute = Absolute(Value=range_2)
absolute_2 = Absolute(Value=range)
addition = Addition(A=absolute_2, B=Slider(0.02, range=0.01..0.1))
division_2 = Division(A=absolute, B=addition)
panel_4 = Panel(here.here)
srf = Surface(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)
srf_2 = Surface(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)

script_parasite = ScriptParasite(Enable=Toggle(False), Folder=here.here)
createpointgeometry_007 = CSharpScript(x=Slider(4.57, range=0..10), y=Slider(10, range=0..10), z=Slider(7.986, range=0..10))  # -> out, A, B, C, D, E, F, G, H, I; inputs x: Double, y: Double, z: Double
# ---------- createpointgeometry_007: C# ----------
    //Algorithms
    //Euclidean Geometry, Similarity, Transformations
    //write an algothim that demonstrates the PLT parallel lines theorem
    //given a line and a point, find the line that is parallel to the given line and passes through the given point
    Line line = new Line(new Point3d(0, 0, 0), new Point3d(x, y, z));
    Point3d point = new Point3d(x, y, 0);
    Line line2 = new Line(point, line.Direction);

    //write and algothim that demonstrates the ITT Isoceles Triangle Theorem
    //given two equal length lines starting at the same point, find the third line that connects ends of the two lines
    Line line3 = new Line(new Point3d(0, 0, 0), new Point3d(x, y, z));
    Line line4 = new Line(new Point3d(0, 0, 0), new Point3d(-x, -y, z));
    Line line5 = new Line(new Point3d(x, y, z), new Point3d(-x, -y, z));

    //write an algothim that demonstrates the VOAT Vertical Opposite Angles Theorem
    //create two intersecting lines, find the angle between the two lines
    Line line6 = new Line(new Point3d(-x, -y, -z), new Point3d(x, y, z));
    Line line7 = new Line(new Point3d(x, y, -z), new Point3d(-x, -y, z));
    //find the angle between the two lines in degrees
    double angle = Vector3d.VectorAngle(line6.Direction, line7.Direction) * 180 / Math.PI;
   
    // Outputs
    A = line;
    B = point;
    C = line2;
    D = line3;
    E = line4;
    F = line5;
    G = line6;
    H = line7;
    I = angle;
# ---------- end createpointgeometry_007 ----------

panel_5 = Panel(createpointgeometry_007.out)
panel_6 = Panel(createpointgeometry_007.I)
point = Point(createpointgeometry_007.B)
line = Line(createpointgeometry_007.D)
line_2 = Line(createpointgeometry_007.E)
line_3 = Line(createpointgeometry_007.F)
line_4 = Line(createpointgeometry_007.H)
line_5 = Line(createpointgeometry_007.A)
line_6 = Line(createpointgeometry_007.C)
line_7 = Line(createpointgeometry_007.G)
merge = Merge(Data1=line_5, Data2=point, Data3=line_6, Data4=line, Data5=line_2, Data6=line_3, Data7=line_7, Data8=line_4)
polar_array = PolarArray(Geometry=merge, Plane=PlaneXY(0, 0, 0), Count=10, Angle=6.283185307)  # -> Geometry, Transform
